# Grasshopper definition DotFractal.gh (Grasshopper 1.0.7)

square_frac_fail = GhPythonScript()  # -> out, obj
# ---------- square_frac_fail: Python ----------
__author__ = "payton"

import rhinoscriptsyntax as rs
from math import cos, sin, tan, pi, radians
import random as rand

def rand_point(corners, length):
    rand_x = rand.uniform(0.0, length)
    rand_y = rand.uniform(0.0, length)
    return [rand_x, rand_y, 0]

length = 10

corner_1 = [length, length, 0]
corner_2 = [0, length, 0]
corner_3 = [0,0,0]
corner_4 = [length, 0, 0]
corners = [corner_1, corner_2, corner_3, corner_4]

plane = rs.WorldXYPlane()
square = rs.AddPlaneSurface(plane, length, length)

point = rand_point(corners, length)

test = rs.AddPoint(point)
obj = [square, test]


for i in range(10000):
    random_corner = corners[rand.randrange(0,4)]
    x = (random_corner[0] + point[0])/3
    y = (random_corner[1] + point[1])/3
    point = [x, y, 0]
    rhino_point = rs.AddPoint(point)
    obj.append(rhino_point)
# ---------- end square_frac_fail ----------
python = GhPythonScript()  # -> out, point
# ---------- python: Python ----------
__author__ = "payton"

import rhinoscriptsyntax as rs
from math import sqrt, cos, sin, radians

length = 10
theta = radians(60)

first_point = [0,0,0]
second_point = [cos(theta)*length, sin(theta)*length, 0]
third_point = [length, 0, 0]
#height_point = [5, 3, sqrt(2)*10/2]
tmp_x = (first_point[0] + second_point[0] + third_point[0])/3
tmp_y = (first_point[1] + second_point[1] + third_point[1])/3
height_point = [tmp_x, tmp_y, sqrt(2)*10/2]
point = [rs.AddPoint(height_point)]
# ---------- end python ----------
tri_base = GhPythonScript()  # -> out, lst
# ---------- tri_base: Python ----------
__author__ = "payton"

import rhinoscriptsyntax as rs
from math import sin, cos, pi, radians

length = 10
theta = radians(60)
first_point = [0,0,0]
second_point = [cos(theta)*length, sin(theta)*length, 0]
third_point = [length, 0, 0]

corners = [first_point, second_point, third_point]
triangle = rs.AddSrfPt(corners)
lst = triangle
# ---------- end tri_base ----------
# Squares
number_slider = Slider(3, range=1..8)
equilateral_triangle = GhPythonScript()  # -> out, points
# ---------- equilateral_triangle: Python ----------
__author__ = "payton"

import rhinoscriptsyntax as rs
from math import cos, sin, tan, pi, radians
import random as rand

def line_left(x, corners):
    slope = (corners[1][1] - corners[0][1])/(corners[1][0] - corners[0][0])
    y = slope*(x - corners[0][0]) + corners[0][1]
    return y

def line_right(x, corners):
    slope = (corners[2][1] - corners[1][1])/(corners[2][0] - corners[1][0])
    y = slope*(x - corners[1][0]) + corners[1][1]
    return y

def line(x, corners, length):
    y =  0
    if x < length/2:
        y = line_left(x, corners)
    elif x >= length/2:
        y = line_right(x, corners)
        
    return y

def rand_point(corners):
    length = 5
    rand_x = rand.uniform(0.0, length-0.2)
    y_limit = line(rand_x, corners, length)
    rand_y = rand.uniform(0.0, y_limit)
    return [rand_x, rand_y, 0]

length = 10
theta = radians(60)
first_point = [0,0,0]
second_point = [cos(theta)*length, sin(theta)*length, 0]
third_point = [length, 0, 0]

corners = [first_point, second_point, third_point]
triangle = rs.AddSrfPt(corners)
point = rand_point(corners)


points = []

for i in range(100000):
    random_corner = corners[rand.randrange(0,3)]
    x = (random_corner[0] + point[0])/2
    y = (random_corner[1] + point[1])/2
    point = [x, y, 0]
    rhino_point = rs.AddPoint(point)
    points.append(rhino_point)
# ---------- end equilateral_triangle ----------
# Triangular Pyramid
triangular_pyramid = ExtrudePoint(Base=tri_base.lst, Point=python.point)
# Pentagon
pentagon = GhPythonScript(divisor=Slider(3, range=1..8), num_points=Slider(40960, range=1000..1000000))  # -> out, points
# ---------- pentagon: Python ----------
__author__ = "payton"

import rhinoscriptsyntax as rs
from math import cos, sin, tan, pi, radians, sqrt
import random as rand

def line_1(x, corners):
    slope = (corners[1][1] - corners[0][1])/(corners[1][0] - corners[0][0])
    y = slope*(x - corners[0][0]) + corners[0][1]
    return y

def line_2(x, corners):
    slope = (corners[2][1] - corners[1][1])/(corners[2][0] - corners[1][0])
    y = slope*(x - corners[1][0]) + corners[1][1]
    return y
    
def line_3(x, corners):
    slope = (corners[3][1] - corners[2][1])/(corners[3][0] - corners[2][0])
    y = slope*(x - corners[2][0]) + corners[2][1]
    return y
    
def line_4(x, corners):
    slope = (corners[4][1] - corners[3][1])/(corners[4][0] - corners[3][0])
    y = slope*(x - corners[3][0]) + corners[3][1]
    return y
    
def line_5(x, corners):
    slope = (corners[4][1] - corners[0][1])/(corners[5][0] - corners[0][0])
    y = slope*(x - corners[0][0]) + corners[0][1]
    return y

def line(x, corners, length):
    y_min =  0
    y_max = 0
    if x < length/2:
        if x < corners[0][0]:
            y_min = line_1(x, corners)
        else:
            y_min = 0
        y_max = line_2(x, corners)
    elif x >= length/2:
        if x > corners[4][0]:
            y_min = line_4(x, corners)
        else:
            y_min = 0
        y_max = line_3(x, corners)
    return [y_min, y_max]

def rand_point(corners):
    length = 5
    rand_x = rand.uniform(corners[1][0], corners[3][0])
    y_limit = line(rand_x, corners, length - 1)
    rand_y = rand.uniform(y_limit[0] + 1, y_limit[1] - 1)
    return [rand_x, rand_y, 0]

length =10
theta = radians(108)
theta_prime = radians(180 - 108)
point_1 = [0,0,0]
point_2 = [cos(theta)*length, sin(theta)*length, 0]
point_5 = [length, 0, 0]
point_4 = [cos(theta_prime)*length + point_5[0], sin(theta_prime)*length, 0]

tmp = [(point_1[0] + point_4[0])/2, (point_1[1] + point_4[1])/2, 0]
tmp = sqrt((tmp[0] - point_5[0])**2 + (tmp[1] - point_5[1])**2)

point_3 = [(point_5[0] + point_1[0])/2,tmp + point_2[1], 0]

corners = [eval("point_%d" %i) for i in range(1,6)]

pentagon = rs.AddSrfPt(corners)
point = rand_point(corners)

points = [point]

for i in range(int(num_points)):
    random_corner = corners[rand.randrange(0,5)]
    x = (random_corner[0] + point[0])/divisor
    y = (random_corner[1] + point[1])/divisor
    point = [x, y, 0]
    rhino_point = rs.AddPoint(point)
    points.append(rhino_point)
# ---------- end pentagon ----------
# Triangles
isoceles_tri = GhPythonScript()  # -> out, points
# ---------- isoceles_tri: Python ----------
__author__ = "payton"

import rhinoscriptsyntax as rs
from math import cos, sin, tan, pi, radians
import random as rand

def line_left(x, corners):
    slope = (corners[1][1] - corners[0][1])/(corners[1][0] - corners[0][0])
    y = slope*(x - corners[0][0]) + corners[0][1]
    return y

def line_right(x, corners):
    slope = (corners[2][1] - corners[1][1])/(corners[2][0] - corners[1][0])
    y = slope*(x - corners[1][0]) + corners[1][1]
    return y

def line(x, corners, length):
    y =  0
    if x < length/2:
        y = line_left(x, corners)
    elif x >= length/2:
        y = line_right(x, corners)
        
    return y

def rand_point(corners):
    length = 5
    rand_x = rand.uniform(0.0, length-0.2)
    y_limit = line(rand_x, corners, length)
    rand_y = rand.uniform(0.0, y_limit)
    return [rand_x, rand_y, 0]

length = 10
theta = radians(60)
first_point = [0,0,0]
second_point = [cos(theta)*length, sin(theta)*(length + 10), 0]
third_point = [length, 0, 0]

corners = [first_point, second_point, third_point]
triangle = rs.AddSrfPt(corners)
print(rs.SurfaceArea(triangle))
point = rand_point(corners)

test = rs.AddPoint(point)
points = [triangle, test]

for i in range(100000):
    random_corner = corners[rand.randrange(0,3)]
    x = (random_corner[0] + point[0])/2
    y = (random_corner[1] + point[1])/2
    point = [x, y, 0]
    rhino_point = rs.AddPoint(point)
    points.append(rhino_point)
# ---------- end isoceles_tri ----------
tria_pyr_frac = GhPythonScript(tri_pyr=triangular_pyramid)  # -> out, points
# ---------- tria_pyr_frac: Python ----------
__author__ = "payton"

import rhinoscriptsyntax as rs
from math import cos, sin, tan, pi, radians, sqrt
import random as rand

def line_base_left(x, corners):
    slope = (corners[1][1] - corners[0][1])/(corners[1][0] - corners[0][0])
    y = slope*(x - corners[0][0]) + corners[0][1]
    return y

def line_base_right(x, corners):
    slope = (corners[2][1] - corners[1][1])/(corners[2][0] - corners[1][0])
    y = slope*(x - corners[1][0]) + corners[1][1]
    return y
def line_height(x, corners, point):
    point = [5, 3, math.sqrt(2)*10/2]
    midway = [(corners[0][0] + corners[1][0])/2, (corners[0][1] + corners[1][1])/2, 0]
    slope = (point[1] - midway[1])/(point[0] - midway[0])
    y = slope*(x - midway[0]) + midway[1]
    return y
    
def line(x, corners, length):
    y =  0
    if x < length/2:
        y = line_base_left(x, corners)
    elif x >= length/2:
        y = line_base_right(x, corners)
        
    return y

def rand_point(corners):
    length = 5
    rand_x = rand.uniform(0.0, length-0.2)
    y_limit = line(rand_x, corners, length)
    rand_y = rand.uniform(0.0, y_limit)
    rand_z = rand.uniform(0.0,sqrt(2)*10/2)
    return [rand_x, rand_y, rand_z]

length = 10
theta = radians(60)

first_point = [0,0,0]
second_point = [cos(theta)*length, sin(theta)*length, 0]
third_point = [length, 0, 0]
#height_point = [5, 3, sqrt(2)*10/2]
tmp_x = (first_point[0] + second_point[0] + third_point[0])/3
tmp_y = (first_point[1] + second_point[1] + third_point[1])/3
height_point = [tmp_x, tmp_y, sqrt(2)*10/2]

corners = [first_point, second_point, third_point, height_point]
triangle = rs.AddSrfPt(corners)

point = rand_point(corners)

points = [triangle]

for i in range(100000):
    valid_point = False
    
    while not valid_point:
        rhino_point = None
        random_corner = corners[rand.randrange(0,4)]
        x = (random_corner[0] + point[0])/2
        y = (random_corner[1] + point[1])/2
        z = (random_corner[2] + point[2])/2
        point = [x, y, z]
        rhino_point = rs.AddPoint(point)
        if rs.IsPointInSurface(tri_pyr, rhino_point) or rs.IsPointOnSurface(tri_pyr, rhino_point):
            points.append(rhino_point)
            valid_point = True
    valid_point = False
# ---------- end tria_pyr_frac ----------
square = GhPythonScript(divisor=number_slider, num_points=Slider(32281, range=1000..100000))  # -> out, obj
# ---------- square: Python ----------
__author__ = "payton"

import rhinoscriptsyntax as rs
from math import cos, sin, tan, pi, radians
import random as rand

def rand_point(corners, length):
    rand_x = rand.uniform(0.0, length)
    rand_y = rand.uniform(0.0, length)
    return [rand_x, rand_y, 0]

length = 10

corner_1 = [length, length, 0]
corner_2 = [0, length, 0]
corner_3 = [0,0,0]
corner_4 = [length, 0, 0]
corners = [corner_1, corner_2, corner_3, corner_4]

plane = rs.WorldXYPlane()
square = rs.AddPlaneSurface(plane, length, length)

point = rand_point(corners, length)

obj = []


for i in range(int(num_points)):
    random_corner = corners[rand.randrange(0,4)]
    x = (random_corner[0] + point[0])/divisor
    y = (random_corner[1] + point[1])/divisor
    point = [x, y, 0]
    rhino_point = rs.AddPoint(point)
    obj.append(rhino_point)
# ---------- end square ----------
scalene_tri = GhPythonScript()  # -> out, points
# ---------- scalene_tri: Python ----------
__author__ = "payton"

import rhinoscriptsyntax as rs
from math import cos, sin, tan, pi, radians
import random as rand

def line_left(x, corners):
    slope = (corners[1][1] - corners[0][1])/(corners[1][0] - corners[0][0])
    y = slope*(x - corners[0][0]) + corners[0][1]
    return y

def line_right(x, corners):
    slope = (corners[2][1] - corners[1][1])/(corners[2][0] - corners[1][0])
    y = slope*(x - corners[1][0]) + corners[1][1]
    return y

def line(x, corners, length):
    y =  0
    if x < length/2:
        y = line_left(x, corners)
    elif x >= length/2:
        y = line_right(x, corners)
        
    return y

def rand_point(corners):
    length = 5
    rand_x = rand.uniform(0.0, length-0.2)
    y_limit = line(rand_x, corners, length)
    rand_y = rand.uniform(0.0, y_limit)
    return [rand_x, rand_y, 0]

length = 10
theta = radians(60)
first_point = [0,0,0]
second_point = [cos(theta)*(length) + 9, sin(theta)*(length + 7), 0]
third_point = [length, 0, 0]

corners = [first_point, second_point, third_point]
triangle = rs.AddSrfPt(corners)
print(rs.SurfaceArea(triangle))
point = rand_point(corners)

test = rs.AddPoint(point)
points = [triangle, test]

for i in range(100000):
    random_corner = corners[rand.randrange(0,3)]
    x = (random_corner[0] + point[0])/2
    y = (random_corner[1] + point[1])/2
    point = [x, y, 0]
    rhino_point = rs.AddPoint(point)
    points.append(rhino_point)
# ---------- end scalene_tri ----------
# Cube
cube = GhPythonScript()  # -> out, obj
# ---------- cube: Python ----------
__author__ = "payton"

import rhinoscriptsyntax as rs
from math import cos, sin, tan, pi, radians
import random as rand

def rand_point(corners, length):
    rand_x = rand.uniform(0.0, length)
    rand_y = rand.uniform(0.0, length)
    rand_z = rand.uniform(0.0, length)
    return [rand_x, rand_y, rand_z]

scale = 2
size = 10
length = size * scale

corner_1 = [length, length, 0]
corner_2 = [0, length, 0]
corner_3 = [0,0,0]
corner_4 = [length, 0, 0]
corner_5 = [length, length, length]
corner_6 = [0, length, length]
corner_7 = [0,0,length]
corner_8 = [length, 0, length]
corners = [eval('corner_%d' %i) for i in range(1,9)]

plane = rs.WorldXYPlane()
square = rs.AddBox(corners)

point = rand_point(corners, length)

obj = []

sides = [0, length]

for i in range(100000):
    valid_point = False
    
    while not valid_point:
        rhino_point = None
        random_side_x = sides[rand.randrange(0,2)]
        random_side_y = sides[rand.randrange(0,2)]
        random_side_z = sides[rand.randrange(0,2)]
        
        x = (random_side_x + point[0])/3
        y = (random_side_y + point[1])/3
        z = (random_side_z + point[2])/3
        point = [x, y, z]
        rhino_point = rs.AddPoint(point)
        if rs.IsPointInSurface(square, rhino_point) or rs.IsPointOnSurface(square, rhino_point):
            obj.append(rhino_point)
            valid_point = True
# ---------- end cube ----------
